% Simulink data dictionary SiEngine.sldd

PlntEngAccPwrTbl = Simulink.Parameter([0 0], DataType="double")
PlntEngAccSpdBpt = Simulink.Parameter([300 750], DataType="double")
PlntEngAfrStoich = Simulink.Parameter(14.6)
PlntEngFuelLhv = Simulink.Parameter(46000000)
PlntEngFuelSg = Simulink.Parameter(0.754)
PlntEngInitTrq = Simulink.Parameter(0, DataType="double")
PlntEngTimeCECP = Simulink.Parameter(0.125, DataType="double")
PlntEngTimeCEGR = Simulink.Parameter(0.125, DataType="double")
PlntEngTimeCETC = Simulink.Parameter(0.085, DataType="double")
PlntEngTimeCICP = Simulink.Parameter(0.125, DataType="double")
PlntEngTimeCIRL = Simulink.Parameter(0.125, DataType="double")
PlntEngTimeCIVL = Simulink.Parameter(0.125, DataType="double")
PlntEngTimeCVCR = Simulink.Parameter(0.125, DataType="double")
PlntEngTimeCVGT = Simulink.Parameter(0.15, DataType="double")
PlntEngTimeCWGA = Simulink.Parameter(0.15, DataType="double")
PlntEngTimeCWVA = Simulink.Parameter(0.125, DataType="double")
PlntEngTwcEffCO = Simulink.Parameter([0.17 0.25 0.45 0.99 0.99 0.99 0.99], DataType="double")
PlntEngTwcEffHC = Simulink.Parameter([0.21 0.375 0.75 0.98 0.98 0.98 0.98], DataType="double")
PlntEngTwcEffLam = Simulink.Parameter([0.909090909 0.944055944 0.979020979 1 1.013986014 1.048951049 1.083916084], DataType="double")
PlntEngTwcEffNOx = Simulink.Parameter([0.98 0.98 0.98 0.97 0.05 0.02 0], DataType="double")