% Simulink data dictionary SiEngineCoreV.sldd
% references SiEngineCore.sldd

PlntEngVCompMassFlwRate = Simulink.Parameter(Simulink.data.Expression(ExpressionString="0.63*PlntEngCmpMAF"), DataType="double")
PlntEngVCompSpdBreakPoints = Simulink.Parameter(Simulink.data.Expression(ExpressionString="1.26*PlntEngCmpSpdBpt"), DataType="double")
PlntEngVTurbMassFlwRate = Simulink.Parameter(Simulink.data.Expression(ExpressionString="0.63*PlntEngTrbMFR"), DataType="double")
PlntEngVTurbSpdBreakPoints = Simulink.Parameter(Simulink.data.Expression(ExpressionString="1.26*PlntEngTrbSpdBpt"), DataType="double")