% Simulink data dictionary VirtualDynoTemplate.sldd
% references SiMappedEngine.sldd
% references SiEngine.sldd
% references SiEngineCore.sldd
% references SiEngineCoreV.sldd
% references SiEngineCoreNA.sldd
% references SiDLEngine.sldd
% references SimpleEngine.sldd
% references CiEngineCore.sldd
% references CiMappedEngine.sldd
% references SiEngineController.sldd
% references CiEngineController.sldd
% references Environment.sldd
% references EngineDynamometer.sldd
% references VirtualDynoConfig.sldd

EngineBUS = Simulink.Bus()
  EngTrq: double
  EngSpdOut: double, Unit="rpm"
  Map: double
  Mat: double
  ThrPosPct: double
  WgAreaPct: double
  IntkCamPhase: double
  ExhCamPhase: double
  TurboRackPos: double
  EgrVlvAreaPct: double
  VarCompRatioPos: double
  IntkVlvLift: double
  VarIntkRunLen: double
  IntkSwirlVlvPos: double
  FuelFlw: double
  FuelVolFlw: double
  IntkPortFlw: double
  NormAirChrg: double
  ExhManGasTemp: double
  Afr: double
  TurboSpd: double, Unit="rad/s"
  TurbPrsRatio: double
  CompPrsRatio: double
  TurbTempOut: double
  CompTempOut: double
  EgrPct: double
  EgrMassFlwRate: double
  EgrCoolerTempOut: double
  IntercoolerTempOut: double
  BSFC: double
  TPHC: double, Unit="kg/s"
  TPCO: double
  TPNOx: double
  TPCO2: double
  Iat: double
  Ect: double
  EgrVlvDeltaPrs: double
  EgrVlvInTemp: double
  CylPrs: double[4 1]
  EngTrqCrk: double
  CrkAng: double