% Simulink data dictionary BMSController.sldd

BalNotActWait = int16(30)
BalOffWait = int16(20)
BalOnWait = int16(60)

BatteryLUT = struct(
  SOC_LUT=[0.01 0.02 0.03 0.04 0.05 0.06 0.07 0.08 0.09 0.1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 1],
  Temperature_LUT=[-10 0 25 40],
  Capacity_LUT=[4.045283 4.196226 4.8 4.739623],
  Em_LUT=[2.673081 2.699838 3.011622 2.862402
   2.744117 2.777096 3.085757 3.103685
   2.804086 2.854582 3.141775 3.250347
   2.862477 2.919469 3.186318 3.348554
   2.908511 2.974179 3.22335 3.430648
   2.949043 3.020006 3.253901 3.421855
   2.982985 3.059291 3.278789 3.43051
   3.014671 3.094965 3.300704 3.440713
   3.040315 3.126745 3.321185 3.432675
   3.062568 3.157189 3.338732 3.430259
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   ],
  R0_LUT=[0.05690268 0.06291642 0.1083836 0.1085269
   0.05755069 0.06271853 0.1042765 0.1176751
   0.05767309 0.062749 0.09750736 0.1232357
   0.05756274 0.06274179 0.09375013 0.1269592
   0.05737873 0.06300545 0.08938195 0.1300718
   0.05719311 0.06295343 0.08546447 0.1176045
   0.05682 0.06228194 0.08175755 0.1098617
   0.05641193 0.06167138 0.07896572 0.1026883
   0.05619743 0.06116047 0.07637004 0.09519208
   0.05608056 0.06063949 0.07435001 0.0894406
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   ],
  R1_LUT=repmat(0.0035, 100, 4),
  C1_LUT=repmat(5000, 100, 4),
  Mass=0.047,
  ThermalMass=44,
  R_bleed=20,
  h_conv=5,
  cell_area=0.0037,
  TempInit=25,
  SOCInit=0.75,
  Model="panasonic ncr18650bd",
  DischargeCycle_LUT=[1 5 9 13 17 21 25 29 33 37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 317],
  deltaEm_LUT=[0 -0.3631156 -0.6000966 -0.68907 -0.7677338 -0.8463976 -0.9263684 -0.9927113 -1.05705 -1.122277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 -3.706745],
  deltaCapacity_LUT=[0 -0.8600191 -1.713324 -2.08194 -2.450556 -2.819172 -3.187787 -3.488849 -3.780815 -4.07278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 -13.30728],
  cond_thickness=0.001,
  thermal_conductivity=205)

CV_Gain = single(0.2)
HighTempLimit = single(50)
I_cc = single(30)
LowTempLimit = single(5)
MaxCellVoltThrsld = single(4.2)
MaxChrgCurrLim = Simulink.Parameter(single(6.36))
MaxDchrgCurrLim = Simulink.Parameter(single(-20))

MinCellVoltDchrgCurrentLimTable = Simulink.LookupTable(
  Table=Simulink.lookuptable.Table(
    Description="Discharge Current Rate Based On Mim Cell Voltage",
    Value=single([0 0.5 1]),
    Dimensions=[1 3],
    DataType="single",
    FieldName="DischargeCurrentRate"),
  BreakpointsSpecification="Explicit values",
  Breakpoints=Simulink.lookuptable.Breakpoint(
    Description="Minimum Cell Voltage",
    Value=[2.5; 2.75; 3],
    TunableSizeName="N1",
    TunableSizeValue=-1,
    Dimensions=[3 1],
    DataType="single",
    Unit="V",
    FieldName="MinCellVoltage"),
  AllowMultipleInstancesOfTypeToHaveDifferentTableBreakpointSizes=false)

OverCellVoltageLimit = single(4.2)
SnsrFltThld = 0.252
TargetDeltaV = single(0.01)
Ts = Simulink.Parameter(0.1, DataType="double")
UnderCellVoltageLimit = single(2.5)
contactorTime = uint16(200)
currentFactor = single(10)
flgEnBalancing = true
noCurrent = single(0)
timeoutContactor = uint8(1)
timeoutCurrent = uint8(1)
vRatio = single(0.95)
voltThreshold = single(4.1)