% Simulink data dictionary Driver.sldd

DriverAeroRes = 0.5
DriverDelayGain = 0.01
DriverDrivelineRes = 75
DriverFrontCornerStiff = 40000
DriverInitialGear = 0
DriverPositionGainF = 6
DriverPositionGainR = 0.25
DriverPreviewDist = 4
DriverRearCornerStiff = 40000
DriverRollRes = 200
DriverShiftTime = 0.1
DriverTimeConst = 0.3
DriverTractiveForce = 15000
DriverWheelRange = 1.0472
DriverYawRateGain = 0.2