% Simulink data dictionary ElectricalThermalSystem.sldd

CtrlThrBattTrgTemp = 298.15
CtrlThrCabRelHTrg = 0.4
CtrlThrCabTrgTemp = 298.15
CtrlThrDCDCTrgTemp = 313.15
CtrlThrEMTrgTemp = 363.15
CtrlThrHpMinTemp = 273.15
CtrlThrIceTrgTemp = 368.15
CtrlThrMinSpd = 0.01
CtrlThrTmDelay = 45
PlnThrRadAirAreaFins = Simulink.Parameter(Simulink.data.Expression(ExpressionString="2*PlntThrRadNFins*PlntThrRadWidth*PlntThrRadGapHeight"))
PlntThrAirCp = [1011 1012 1014 1017 1019 1022 1035]
PlntThrAirCpBpt = [273.15 293.15 313.15 333.15 353.15 373.15 473.15]
PlntThrBattJacLen = 2.8
PlntThrBattPlateCp = 900
PlntThrBattTau = 120
PlntThrCOPc = 8
PlntThrCOPe = 4
PlntThrCabCO2Init = 0.0004
PlntThrCabDucArea = 0.04
PlntThrCabFanMaxFlw = 0.15
PlntThrCabHtc = 40
PlntThrCabK = 7.7
PlntThrCabNPass = 1
PlntThrCabRelHInit = 0.4
PlntThrCabTau = 120
PlntThrCabTempAvg = 303.15
PlntThrCabVolume = 3
PlntThrChArea = Simulink.Parameter(Simulink.data.Expression(ExpressionString="pi*PlntThrChDia^2/4"))
PlntThrChDia = 0.019

PlntThrChlrAreaBaffl = Simulink.Parameter(Simulink.data.Expression(
  ExpressionString="PlntThrChlrNBaffl*0.7*2*PlntThrChlrNTubes*((2*PlntThrChlrTubeD)^2-pi*PlntThrChlrTubeD^2/4)"))

PlntThrChlrAreaPrm = Simulink.Parameter(Simulink.data.Expression(ExpressionString="PlntThrChlrNTubes*pi*PlntThrChlrTubeD*PlntThrChlrTubeL"))
PlntThrChlrNBaffl = 3
PlntThrChlrNTubes = 100
PlntThrChlrNomH2OPin = 101425
PlntThrChlrNomH2OTin = 305
PlntThrChlrNseg = Simulink.Parameter(Simulink.data.Expression(ExpressionString="sqrt(PlntThrChlrNTubes)"))
PlntThrChlrPitch = Simulink.Parameter(Simulink.data.Expression(ExpressionString="2*PlntThrChlrTubeD"))
PlntThrChlrRows = Simulink.Parameter(Simulink.data.Expression(ExpressionString="sqrt(PlntThrChlrNTubes)*(PlntThrChlrNBaffl+1)"))
PlntThrChlrSegL = Simulink.Parameter(Simulink.data.Expression(ExpressionString="PlntThrChlrTubeL/(PlntThrChlrNBaffl+1)"))
PlntThrChlrThermRes = Simulink.Parameter(Simulink.data.Expression(ExpressionString="PlntThrChlrWallThk/PlntThrChlrAreaPrm/PlntThrChlrWallCond"))
PlntThrChlrTubeD = 0.0035
PlntThrChlrTubeL = 0.4
PlntThrChlrTubeLeq = Simulink.Parameter(Simulink.data.Expression(ExpressionString="2*0.2*PlntThrChlrTubeD*PlntThrChlrNTubes"))
PlntThrChlrWallCond = 240
PlntThrChlrWallThk = 0.0001
PlntThrCmpDispl = 80
PlntThrCmpMaxSpd = 3600
PlntThrCondAirAreaFlw = Simulink.Parameter(Simulink.data.Expression(ExpressionString="(PlntThrCondNTubes-1)*PlntThrCondTubeLen*PlntThrCondGapHeight"))
PlntThrCondAirVol = Simulink.Parameter(Simulink.data.Expression(ExpressionString="PlntThrCondAirAreaFlw*PlntThrCondWidth"))
PlntThrCondAreaFins = Simulink.Parameter(Simulink.data.Expression(ExpressionString="2*PlntThrCondNFins*PlntThrCondWidth*PlntThrCondGapHeight"))

PlntThrCondAreaPr = Simulink.Parameter(Simulink.data.Expression(
  ExpressionString="2*(PlntThrCondNTubes-1)*PlntThrCondWidth*(PlntThrCondTubeLen+PlntThrCondGapHeight)"))

PlntThrCondFinSpacing = 0.0005

PlntThrCondGapHeight = Simulink.Parameter(Simulink.data.Expression(
  ExpressionString="(PlntThrCondHeight-PlntThrCondNTubes*PlntThrCondTubeHeight)/(PlntThrCondNTubes-1)"))

PlntThrCondHeight = 0.39
PlntThrCondNChannels = 12
PlntThrCondNFins = Simulink.Parameter(Simulink.data.Expression(ExpressionString="(PlntThrCondNTubes-1)*PlntThrCondTubeLen/PlntThrCondFinSpacing"))
PlntThrCondNTubes = 40
PlntThrCondThrRes = Simulink.Parameter(Simulink.data.Expression(ExpressionString="PlntThrCondWallTk/PlntThrCondAreaPr/PlntThrCondWallK"))

PlntThrCondTubAreaWbs = Simulink.Parameter(Simulink.data.Expression(
  ExpressionString="2*PlntThrCondNTubes*(PlntThrCondNChannels-1)*PlntThrCondTubeLen*PlntThrCondTubeHeight"))

PlntThrCondTubeEqLen = Simulink.Parameter(Simulink.data.Expression(
  ExpressionString="2*(PlntThrCondHeight+20*PlntThrCondTubeHeight*PlntThrCondNTubes)+(PlntThrCondNChannels-1)*PlntThrCondTubeLen*PlntThrCondTubeHeight/(PlntThrCondWidth+PlntThrCondTubeHeight)"))

PlntThrCondTubeHeight = 0.002
PlntThrCondTubeLen = 1.26
PlntThrCondWallK = 240
PlntThrCondWallTk = 0.0001
PlntThrCondWidth = 0.015
PlntThrCoolCond = [0.4331 0.4308 0.4285 0.4261 0.4238 0.4214 0.419 0.4167 0.4143 0.412 0.4096 0.4072 0.4049 0.4026 0.4002 0.3979 0.3957 0.3934 0.3912 0.3889]
PlntThrCoolCp = [2939 3006 3072 3135 3195 3253 3307 3359 3407 3452 3493 3530 3563 3592 3618 3638 3654 3666 3672 3674]
PlntThrCoolCpBpt = [233 241 250 258 266 275 283 292 300 309 317 326 334 342 351 359 368 376 385 393]
PlntThrCoolTnkArea = 0.0121
PlntThrCoolTnkVol = 5
PlntThrCoolVisc = Simulink.Parameter(Simulink.data.Expression(ExpressionString="PlntThrCoolViscP/1000"))
PlntThrCoolViscP = [76.42 49.31 32.24 21.39 14.42 9.9 6.93 4.95 3.62 2.71 2.08 1.64 1.33 1.12 0.964 0.861 0.796 0.764 0.761 0.788]
PlntThrDCDCTau = 160
PlntThrDCJacLen = 1.2
PlntThrDoorsArea = 2
PlntThrDoorsK = 0.08
PlntThrDoorsTk = 0.03
PlntThrEMJacLen = 2.4
PlntThrEMTau = 160
PlntThrEqLength = Simulink.Parameter(Simulink.data.Expression(ExpressionString="20*PlntThrChDia*4"))
PlntThrEstCondTemp = 303.15
PlntThrEvapAirAreaFins = Simulink.Parameter(Simulink.data.Expression(ExpressionString="2*PlntThrEvapNFins*PlntThrEvapWidth*PlntThrEvapGapH"))
PlntThrEvapAirAreaFlw = Simulink.Parameter(Simulink.data.Expression(ExpressionString="(PlntThrEvapNTubes-1)*PlntThrEvapLen*PlntThrEvapGapH"))
PlntThrEvapAirVol = Simulink.Parameter(Simulink.data.Expression(ExpressionString="PlntThrEvapAirAreaFlw*PlntThrEvapWidth"))

PlntThrEvapAreaPrm = Simulink.Parameter(Simulink.data.Expression(
  ExpressionString="2*(PlntThrEvapNTubes-1)*PlntThrEvapWidth*(PlntThrEvapLen+PlntThrEvapGapH)"))

PlntThrEvapAreaWebs = Simulink.Parameter(Simulink.data.Expression(
  ExpressionString="2*PlntThrEvapNTubes*(PlntThrEvapNTubeChan-1)*PlntThrEvapLen*PlntThrEvapGapH"))

PlntThrEvapFinSpace = 0.0005

PlntThrEvapGapH = Simulink.Parameter(Simulink.data.Expression(
  ExpressionString="(PlntThrEvapHeight-PlntThrEvapNTubes*PlntThrEvapTubeH)/(PlntThrEvapNTubes-1)"))

PlntThrEvapHeight = 0.2
PlntThrEvapLen = 0.75
PlntThrEvapNFins = Simulink.Parameter(Simulink.data.Expression(ExpressionString="(PlntThrEvapNTubes-1)*PlntThrEvapLen/PlntThrEvapFinSpace"))
PlntThrEvapNTubeChan = 12
PlntThrEvapNTubes = 20
PlntThrEvapThermRes = Simulink.Parameter(Simulink.data.Expression(ExpressionString="PlntThrEvapWallThk/PlntThrEvapAreaPrm/PlntThrEvapWallCond"))
PlntThrEvapTubeH = 0.002

PlntThrEvapTubeLeq = Simulink.Parameter(Simulink.data.Expression(
  ExpressionString="2*(PlntThrEvapHeight+20*PlntThrEvapTubeH*PlntThrEvapNTubes)+(PlntThrEvapNTubeChan-1)*PlntThrEvapLen*PlntThrEvapTubeH/(PlntThrEvapWidth+PlntThrEvapTubeH)"))

PlntThrEvapWallCond = 240
PlntThrEvapWallThk = 0.0001
PlntThrEvapWidth = 0.015
PlntThrExpArea = Simulink.Parameter(Simulink.data.Expression(ExpressionString="pi*PlntThrExpDia^2/4"))
PlntThrExpDia = Simulink.Parameter(Simulink.data.Expression(ExpressionString="0.8*PlntThrRefrigDia"))
PlntThrFanMaxSpd = 1000
PlntThrFanMechEff = 0.9
PlntThrFanNomP = 400
PlntThrFanVolEff = 0.85
PlntThrGlassArea = 3.5
PlntThrGlassK = 0.96
PlntThrGlassTk = 0.002
PlntThrHeaterCoeff = 200
PlntThrHeaterJacArea = 1
PlntThrHeaterJacVol = 0.001
PlntThrHeaterMaxPwr = 4000
PlntThrHexAreaPr = Simulink.Parameter(Simulink.data.Expression(ExpressionString="PlntThrHexNTubes*pi*PlntThrHexTubeDia*PlntThrHexTubeLen"))
PlntThrHexNTubes = 64
PlntThrHexThermalR = Simulink.Parameter(Simulink.data.Expression(ExpressionString="PlntThrRadWallThk/PlntThrHexAreaPr/PlntThrRadWallK"))
PlntThrHexTubeDia = 0.0035
PlntThrHexTubeLEq = Simulink.Parameter(Simulink.data.Expression(ExpressionString="2*0.2*PlntThrHexTubeDia*PlntThrHexNTubes"))
PlntThrHexTubeLen = 0.1
PlntThrICETau = 100
PlntThrICondAirVol = Simulink.Parameter(Simulink.data.Expression(ExpressionString="PlntThrICondAreaFlw*PlntThrICondWdt"))
PlntThrICondAreaFins = Simulink.Parameter(Simulink.data.Expression(ExpressionString="2*PlntThrICondNFins*PlntThrICondWdt*PlntThrICondGapHgt"))
PlntThrICondAreaFlw = Simulink.Parameter(Simulink.data.Expression(ExpressionString="(PlntThrICondNTubes-1)*PlntThrICondLen*PlntThrICondGapHgt"))

PlntThrICondAreaPr = Simulink.Parameter(Simulink.data.Expression(
  ExpressionString="2*(PlntThrICondNTubes-1)*PlntThrICondWdt*(PlntThrICondLen+PlntThrICondGapHgt)"))

PlntThrICondFinSpc = 0.0005

PlntThrICondGapHgt = Simulink.Parameter(Simulink.data.Expression(
  ExpressionString="(PlntThrICondHgt-PlntThrICondNTubes*PlntThrICondTubHgt)/(PlntThrICondNTubes-1)"))

PlntThrICondHgt = 0.39
PlntThrICondLen = 0.63
PlntThrICondNChan = 15
PlntThrICondNFins = Simulink.Parameter(Simulink.data.Expression(ExpressionString="(PlntThrICondNTubes-1)*PlntThrICondLen/PlntThrICondFinSpc"))
PlntThrICondNTubes = 40
PlntThrICondThermalR = Simulink.Parameter(Simulink.data.Expression(ExpressionString="PlntThrRadWallThk/PlntThrICondAreaPr/PlntThrRadWallK"))

PlntThrICondTubAWb = Simulink.Parameter(Simulink.data.Expression(
  ExpressionString="2*PlntThrICondNTubes*(PlntThrICondNChan-1)*PlntThrICondTubHgt*PlntThrICondLen"))

PlntThrICondTubHgt = 0.002

PlntThrICondTubLEq = Simulink.Parameter(Simulink.data.Expression(
  ExpressionString="2*(PlntThrICondHgt+20*PlntThrICondTubHgt*PlntThrICondNTubes)+(PlntThrICondNChan-1)*PlntThrICondLen*PlntThrICondTubHgt/(PlntThrICondWdt+PlntThrICondTubHgt)"))

PlntThrICondWdt = 0.02
PlntThrPTCArea = 1
PlntThrPTCCp = 447
PlntThrPTCHtc = 200
PlntThrPTCLimTemp = 473.15
PlntThrPTCPwrGain = 2500
PlntThrPTCmass = 1.5
PlntThrPipeArea = Simulink.Parameter(Simulink.data.Expression(ExpressionString="pi*PlntThrPipeDia^2/4"))
PlntThrPipeDia = 0.025
PlntThrPmpDisp = 0.02
PlntThrPmpHeadP = 100000
PlntThrPmpMaxSpd = 3600
PlntThrPmpMechEff = 0.996
PlntThrPmpVolEff = 0.9
PlntThrRadAirArea = Simulink.Parameter(Simulink.data.Expression(ExpressionString="PlntThrRadAirAreaPr+PlntThrRadFinEff*PlnThrRadAirAreaFins"))
PlntThrRadAirAreaFins = Simulink.Parameter(Simulink.data.Expression(ExpressionString="2*PlntThrRadNFins*PlntThrRadWidth*PlntThrRadGapHeight"))
PlntThrRadAirAreaFlw = Simulink.Parameter(Simulink.data.Expression(ExpressionString="(PlntThrRadNTubes+1)*PlntThrRadLength*PlntThrRadGapHeight*0.9"))  % Added a 0.9 correction factor to account for fin thickness and fin louvers

PlntThrRadAirAreaPr = Simulink.Parameter(Simulink.data.Expression(
  ExpressionString="2*(PlntThrRadNTubes+1)*PlntThrRadWidth*(PlntThrRadLength+PlntThrRadGapHeight)"))

PlntThrRadAirDh = Simulink.Parameter(Simulink.data.Expression(
  ExpressionString="2*PlntThrRadLength*PlntThrRadGapHeight/(PlntThrRadLength+PlntThrRadGapHeight)"))

PlntThrRadAirFoul = 0.1
PlntThrRadCoolFoul = 0.1
PlntThrRadFanAreaFlw = Simulink.Parameter(Simulink.data.Expression(ExpressionString="0.7*PlntThrRadAirAreaFlw"))
PlntThrRadFinEff = 0.7
PlntThrRadFinSpace = 0.002
PlntThrRadFlwCoef = 0.3

PlntThrRadGapHeight = Simulink.Parameter(Simulink.data.Expression(
  ExpressionString="(PlntThrRadHeight-PlntThrRadNTubes*PlntThrRadTubeHeight)/(PlntThrRadNTubes+1)"))

PlntThrRadHeight = 0.4
PlntThrRadLength = 0.6
PlntThrRadMoistAirVol = Simulink.Parameter(Simulink.data.Expression(ExpressionString="PlntThrRadAirAreaFlw*PlntThrRadWidth"))
PlntThrRadNFins = Simulink.Parameter(Simulink.data.Expression(ExpressionString="(PlntThrRadNTubes+1)*PlntThrRadLength/PlntThrRadFinSpace"))
PlntThrRadNTubes = 38
PlntThrRadThermalR = Simulink.Parameter(Simulink.data.Expression(ExpressionString="PlntThrRadWallThk/PlntThrRadAirAreaPr/PlntThrRadWallK"))

PlntThrRadTubeDh = Simulink.Parameter(Simulink.data.Expression(
  ExpressionString="2*PlntThrRadWidth*PlntThrRadTubeHeight/(PlntThrRadWidth+PlntThrRadTubeHeight)"))

PlntThrRadTubeHeight = 0.0015
PlntThrRadTubeLEq = Simulink.Parameter(Simulink.data.Expression(ExpressionString="2*(PlntThrRadHeight+20*PlntThrRadTubeHeight*PlntThrRadNTubes)"))
PlntThrRadWallK = 240
PlntThrRadWallThk = 0.0001
PlntThrRadWidth = 0.015
PlntThrRefrigAinit = 0.6
PlntThrRefrigArea = Simulink.Parameter(Simulink.data.Expression(ExpressionString="pi*PlntThrRefrigDia^2/4"))
PlntThrRefrigDia = 0.0125
PlntThrRefrigPinit = 800000
PlntThrRoofArea = 2
PlntThrRoofK = 0.08
PlntThrRoofTk = 0.02
PlntThrValDisp = 0.0063
PlntThrValDratioMax = 0.95
PlntThrValDratioMin = 0.001
PlntThrValRefrDisp = 0.005
PlntThrValRefrDratio = 0.95
PlntThrValSplMax = 0.0053