% Simulink data dictionary Environment.sldd

EnvAbsPrs = 101325
EnvAirDen = 1.18
EnvAirTemp = 293.15
EnvGrvty = 9.81
EnvNomFrictionScaling = 1
EnvNominalGrade = 0

EnvScnFrictionMap = single([2 2 2 2 2 2 2 2 2 2 2 2 2 2 2 2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
 2 2 2 2 2 2 2 2 2 2 2 2 2 2 2 2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
 2 2 2 2 2 2 2 2 2 2 2 2 2 2 2 2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
 2 2 2 2 2 2 2 2 2 2 2 2 2 2 2 2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
 2 2 2 2 2 2 2 2 2 2 2 2 2 2 2 2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
 2 2 2 2 2 2 2 2 2 2 2 2 2 2 2 2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
 2 2 2 2 2 2 2 2 2 2 2 2 2 2 2 2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
 2 2 2 2 2 2 2 2 2 2 2 2 2 2 2 2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
 2 2 2 2 2 2 2 2 2 2 2 2 2 2 2 2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
 2 2 2 2 2 2 2 2 2 2 2 2 2 2 2 2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 ])

EnvScnFrictionMapXBpts = single([1369.1 1369.2 1369.3 1369.4 1369.5 1369.6 1369.7 1369.8 1369.9 1370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 1517.3])
EnvScnFrictionMapYBpts = single([1012.95 1013.05 1013.15 1013.25 1013.35 1013.45 1013.55 1013.65 1013.75 1013.85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 1465.35])

EnvScnHeightMap = single([240 240 240 240 240 240 240 240 240 240 240 240 240 240 240 240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
 240 240 240 240 240 240 240 240 240 240 240 240 240 240 240 240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
 240 240 240 240 240 240 240 240 240 240 240 240 240 240 240 240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
 240 240 240 240 240 240 240 240 240 240 240 240 240 240 240 240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
 240 240 240 240 240 240 240 240 240 240 240 240 240 240 240 240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
 240 240 240 240 240 240 240 240 240 240 240 240 240 240 240 240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
 240 240 240 240 240 240 240 240 240 240 240 240 240 240 240 240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
 240 240 240 240 240 240 240 240 240 240 240 240 240 240 240 240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
 240 240 240 240 240 240 240 240 240 240 240 240 240 240 240 240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
 240 240 240 240 240 240 240 240 240 240 240 240 240 240 240 240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 ])

EnvScnHeightMapXBpts = single([1369.1 1369.2 1369.3 1369.4 1369.5 1369.6 1369.7 1369.8 1369.9 1370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 1517.3])
EnvScnHeightMapYBpts = single([1012.95 1013.05 1013.15 1013.25 1013.35 1013.45 1013.55 1013.65 1013.75 1013.85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 1465.35])
EnvWindVelX = 0
EnvWindVelY = 0
EnvWindVelZ = 0