% Simulink data dictionary EvVCU.sldd

CtrlVcuEvBattChrgPwrMax = -211000
CtrlVcuEvBattDischrgPwrMax = 211000
CtrlVcuEvChrgLmtBpt = [1 1 1 1 1 1 1 1 0.7 0.35 0]
CtrlVcuEvDischrgLmtBpt = [0 0.35 0.7 1 1 1 1 1 1 1 1]
CtrlVcuEvRegenBrkCutOff = [0 1]
CtrlVcuEvRegenBrkSpdBpt = [5 9]
CtrlVcuEvSocBpt = [0 10 20 30 40 50 60 70 80 90 100]