% Simulink data dictionary HevPxVCU.sldd

CtrlVcuHevP0ECMSs = 3.5026
CtrlVcuHevP1ECMSs = 3.597
CtrlVcuHevP2ECMSs = 3.5876
CtrlVcuHevP3ECMSs = 3.7551
CtrlVcuHevP4ECMSs = 3.7467
CtrlVcuHevPxAdaptECMSKiGain = 0.1
CtrlVcuHevPxAdaptECMSKpGain = 3
CtrlVcuHevPxBattChrgPwrMax = -30000
CtrlVcuHevPxBattCurrMax = 150
CtrlVcuHevPxBattDischrgPwrMax = 46000
CtrlVcuHevPxChrgLmtBpt = [1 1 1 1 1 1 1 0.9 0.7 0.5 0]
CtrlVcuHevPxDischrgLmtBpt = [0 0.5 0.7 0.9 1 1 1 1 1 1 1]
CtrlVcuHevPxECMSKi = 0.1
CtrlVcuHevPxECMSKp = 3
CtrlVcuHevPxECMSmethod = 1
CtrlVcuHevPxEngTrqMin = [0 6.478395 6.81038 6.987249 7.210808 7.41443 7.608715 7.788365 7.961072 8.105103 8.24672 8.364697 8.496744 8.620051 8.747157 8.88039]
CtrlVcuHevPxNgrid = 200
CtrlVcuHevPxPenaltyFctr = 10000000
CtrlVcuHevPxPnltyFctr = 3
CtrlVcuHevPxRegenBrkCutOff = [0 1]
CtrlVcuHevPxSOCTrgt = 60
CtrlVcuHevPxSOCmax = 80
CtrlVcuHevPxSOCmin = 40
CtrlVcuHevPxSocBpt = [0 0.1 0.2 0.3 0.4 0.5 0.6 0.7 0.8 0.9 1]
CtrlVcuHevPxTransEffTbl = reshape([0.86 0.85 0.87 0.86 0.9 0.9 0.9 0.9 0.86 0.85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], 2, 2, 10, 2)
CtrlVcuHevPxTransGearNumVect = [0 1 2 3 4 5 6 7 8 9]
CtrlVcuHevPxTransGearRatioVect = [3 1 4.75 3.75 3.25 2.75 2.25 1.5 1 0.75]