% Simulink data dictionary PassVeh.sldd

CtrlBcuTrlrBrkGain = 0
CtrlTrgtWhlSlip = -0.05
PlntBrkActrBoreFrnt = 0.05
PlntBrkActrBoreRear = 0.05
PlntBrkBreakFricVelFrnt = 0.1
PlntBrkBreakFricVelRear = 0.1
PlntBrkFrntBias = 1
PlntBrkKinFricCffFrnt = 0.35
PlntBrkKinFricCffRear = 0.35
PlntBrkNumPadsFrnt = 2
PlntBrkNumPadsRear = 2
PlntBrkPadMeanRadiusFrnt = 0.15
PlntBrkPadMeanRadiusRear = 0.15
PlntBrkPrsFctr = 8000000
PlntBrkRearBias = 0.6
PlntBrkSpoolFrnt = 50
PlntBrkSpoolRear = 50
PlntBrkStcFricCffFrnt = 0.45
PlntBrkStcFricCffRear = 0.45
PlntBrkViscFricFrnt = 0
PlntBrkViscFricRear = 0
PlntBrkWc = 125.6637
PlntSp3DofAxlDispDataFrnt = [-0.005 -0.0001 0 0.2 0.2001 0.2051]
PlntSp3DofAxlDispDataRear = [-0.005 -0.0001 0 0.2 0.2001 0.2051]
PlntSp3DofAxlDmpFrcFrnt = [-10000 -100 -10 0 10 100 10000]
PlntSp3DofAxlDmpFrcRear = [-10000 -100 -10 0 10 100 10000]
PlntSp3DofAxlStffFrcDataFrnt = [-750000 -15000 0 30000 45000 780000]
PlntSp3DofAxlStffFrcDataRear = [-500000 -10000 0 20000 30000 520000]
PlntSp3DofAxlVelDataFrnt = [-10 -1 -0.1 0 0.1 1 10]
PlntSp3DofAxlVelDataRear = [-10 -1 -0.1 0 0.1 1 10]
PlntSpKCAlgnTrqCambCompl = [0 0 0 0]
PlntSpKCAlgnTrqSteerCompl = [0 0 0 0]
PlntSpKCBumpCamber = [0 0 0 0]
PlntSpKCBumpCaster = [0 0 0 0]
PlntSpKCBumpSteer = [0 0 0 0]
PlntSpKCCambVsSteerAng = [0 0 0 0]
PlntSpKCCastVsSteerAng = [0 0 0 0]
PlntSpKCLatCambCompl = [0 0 0 0]
PlntSpKCLatSteerCompl = [0 0 0 0]
PlntSpKCLatWhlCtrComplLat = [0 0 0 0]
PlntSpKCLatWhlCtrComplLng = repmat(0, 2, 4)
PlntSpKCLatWhlCtrDisp = [0 0 0 0]
PlntSpKCLngCambCompl = repmat(0, 2, 4)
PlntSpKCLngCastCompl = repmat(0, 2, 4)
PlntSpKCLngSteerCompl = repmat(0, 2, 4)
PlntSpKCLngWhlCtrCompl = repmat(0, 2, 4)
PlntSpKCLngWhlCtrDisp = [0 0 0 0]
PlntSpKCMotRatios = [1 1]
PlntSpKCNrmlWhlFrcOff = [4000 4000 2600 2600]
PlntSpKCNrmlWhlRates = [28 28 25 25]
PlntSpKCRollCamber = [0 0]
PlntSpKCRollCaster = [0 0]
PlntSpKCRollSteer = [0 0]
PlntSpKCRollStiffArb = [930 820]
PlntSpKCRollStiffArbFrnt = 0
PlntSpKCRollStiffNoArb = [470 480]
PlntSpKCRollStiffNoArbFrnt = 0
PlntSpKCRollStiffNoTwstRear = 0
PlntSpKCShckFrcVsCompRate = [1.414 1.414 1.414 1.414]
PlntSpKCStatCamber = [0 0 0 0]
PlntSpKCStatCaster = [0 0 0 0]
PlntSpKCStatToe = [0 0 0 0]
PlntSpKCVrtLdTrnsfr = [0 0 0 0]
PlntSpMSAntiSwayNeutralAngle = 0.5236
PlntSpMSAntiSwayRadius = 0.2
PlntSpMSAntiSwayTorsionStiffness = 800
PlntSpMSDamping = 2782.612
PlntSpMSHeightVsSteer = 0.1432
PlntSpMSMaxHeight = 0.25
PlntSpMSPreload = 2886
PlntSpMSStatCamber = 0
PlntSpMSStatCaster = 0
PlntSpMSStatToe = 0
PlntSpMSStiffness = 26225.5
PlntSpSAAxleMass = 160
PlntSpSAAxleWheelDamping = 11490.97
PlntSpSAAxleWheelPreload = 2907
PlntSpSAAxleWheelStiffness = 138031.6
PlntSpSADamping = 5565.225
PlntSpSAMaxHeight = 0.25
PlntSpSAPreload = 2886
PlntSpSARollInertia = 62.37452
PlntSpSAStatCamber = 0
PlntSpSAStatCaster = 0
PlntSpSAStatToe = 0
PlntSpSAStiffness = 52451.01
PlntSpStatLdWhlR = [0.3 0.3 0.3 0.3]
PlntSteerDst = 0.2
PlntSteerEpsilon = 0.9
PlntSteerGearRatio = 52.02477
PlntSteerHbLead = 4.0e-5
PlntSteerHysStiff = 30
PlntSteerKngpnOfst = 0.075
PlntSteerLambda = 0.2094395
PlntSteerLftWhlAngTbl = [-0.3490659 -0.1675516 -0.0395608 0.0395608 0.1675516 0.3490659]
PlntSteerLowerInertia = 0.01
PlntSteerMaxDamp = 1
PlntSteerMaxStf = 10000
PlntSteerMaxUpprFric = 0.2
PlntSteerPctAck = 100
PlntSteerPnInert = 0.1
PlntSteerPrsFric = 1.0e-5
PlntSteerPwrLimit = 1000
PlntSteerRackDispBpt = [-40 -19.2 -4.53 4.53 19.2 40]
PlntSteerRange = 9.77
PlntSteerRatio = 14
PlntSteerRckCsLngth = 1.075
PlntSteerRckGn = 0.01
PlntSteerRghtWhlAngTbl = [-0.3490659 -0.1675516 -0.0395608 0.0395608 0.1675516 0.3490659]
PlntSteerSlgStf = 15000
PlntSteerStcLdRadius = 0.4
PlntSteerStrgArmLngth = 0.1
PlntSteerTieRodLngth = 0.248
PlntSteerTorDamp = 1
PlntSteerTorStf = 30
PlntSteerTrqAsstTbl = [0 -100; 0 0; 0 100]
PlntSteerTrqLimit = 100
PlntSteerUpperInertia = 0.1
PlntSteerUpprFric = 1
PlntSteerWc = 200
PlntSteerWheelTrqBpt = [-100 0 100]
PlntVeh3DOFFrntSuspDamp = 10000
PlntVeh3DOFFrntSuspStiff = 10000
PlntVeh3DOFRearSuspDamp = 10000
PlntVeh3DOFRearSuspStiff = 10000
PlntVehAeroBetaWindAng = [-3.141593 -2.792638 -2.443683 -2.094728 -1.745774 -1.396819 -1.047864 -0.6989095 -0.3499547 -0.001 0 0.001 0.3499547 0.6989095 1.047864 1.396819 1.745774 2.094728 2.443683 2.792638 3.141593]
PlntVehAeroDragCff = 0.23
PlntVehAeroFrntArea = 2.27
PlntVehAeroLiftCff = 0.1
PlntVehAeroPitchCff = -0.1
PlntVehAeroSideCs = [0.5 0.4445556 0.3891111 0.3336667 0.2782222 0.2227778 0.1673333 0.1118889 0.05644444 0.001 0 0.001 0.05644444 0.1118889 0.1673333 0.2227778 0.2782222 0.3336667 0.3891111 0.4445556 0.5]
PlntVehAeroYawCym = [-0.1 -0.089 -0.078 -0.067 -0.056 -0.045 -0.034 -0.023 -0.012 -0.001 0 0.001 0.012 0.023 0.034 0.045 0.056 0.067 0.078 0.089 0.1]
PlntVehCGHgtAxl = 0.3
PlntVehDstCGFrntAxl = 1.09
PlntVehDstCGRearAxl = 1.7
PlntVehFrntUnsprgMass = 100
PlntVehFzFlt = 10
PlntVehHtchDst = 2.25
PlntVehHtchHgtAxl = 0
PlntVehHtchLatDst = 0
PlntVehInitLatPos = 0
PlntVehInitLatVel = 0
PlntVehInitLongPos = 0
PlntVehInitLongVel = 0
PlntVehInitPitchAng = 0
PlntVehInitPitchRate = 0
PlntVehInitRollAng = 0
PlntVehInitRollRate = 0
PlntVehInitVertPos = 0
PlntVehInitVertVel = 0
PlntVehInitYawAng = 0
PlntVehInitYawRate = 0
PlntVehMass = 1623
PlntVehNumWhlFrntAxl = 2
PlntVehNumWhlRearAxl = 2
PlntVehPitchMomentInertia = 1922.7
PlntVehRearUnsprgMass = 100
PlntVehRollMomentInertia = 432.3333
PlntVehRollResCffa = 196
PlntVehRollResCffb = 2.232
PlntVehTrckWdth = [1.575 1.575]
PlntVehYawMomentInertia = 2066
PlntWhlAspctRatioFrnt = 0.59239
PlntWhlAspctRatioRear = 0.59239
PlntWhlCambStiffFrnt = -3413.1559
PlntWhlCambStiffRear = -3413.1559
PlntWhlCompDamp = 50000
PlntWhlCompStiff = 500000
PlntWhlDampCoeffFrnt = 0.001
PlntWhlDampCoeffRear = 0.001
PlntWhlFricRedFctrFrnt = 0.032684
PlntWhlFricRedFctrRear = 0.032684
PlntWhlHubCompDamp = 40000
PlntWhlHubCompStiff = 1000000
PlntWhlInertia = [1.084 1.084 1.084 1.084]
PlntWhlInertiaFrnt = 0.8
PlntWhlInertiaRear = 0.8
PlntWhlInitAngVelFrnt = 0
PlntWhlInitAngVelRear = 0
PlntWhlInitVelFrnt = 0
PlntWhlInitVelRear = 0
PlntWhlInitVertVelFrnt = 0
PlntWhlInitVertVelRear = 0
PlntWhlKinFricCffFrnt = 0.17601
PlntWhlKinFricCffRear = 0.17601
PlntWhlLatStiffFrnt = 104298.5693
PlntWhlLatStiffRear = 104298.5693
PlntWhlLdRadiusFrnt = 0.327
PlntWhlLdRadiusRear = 0.327
PlntWhlLinYawRateResFrnt = 0
PlntWhlLinYawRateResRear = 0
PlntWhlLnrVelForceCompFrnt = 0
PlntWhlLnrVelForceCompRear = 0
PlntWhlLongCuvFctrFrnt = 0.97
PlntWhlLongCuvFctrRear = 0.97
PlntWhlLongPeakFctrFrnt = 1
PlntWhlLongPeakFctrRear = 1
PlntWhlLongScaleFctr = 0.9
PlntWhlLongShapeFctrFrnt = 1.9
PlntWhlLongShapeFctrRear = 1.9

PlntWhlLongSpdFrnt = 16.7
PlntWhlLongSpdRear = 16.7
PlntWhlLongStfFctrFrnt = 10
PlntWhlLongStfFctrRear = 10
PlntWhlLongStiffFrnt = 2175325.388
PlntWhlLongStiffRear = 2175325.388
PlntWhlMass = [11.2 11.2 11.2 11.2]
PlntWhlMassFrnt = 11.2
PlntWhlMassRear = 11.2
PlntWhlMaxCmbrFrnt = 0.17453
PlntWhlMaxCmbrRear = 0.17453
PlntWhlMaxFricScaleCffFrnt = 1.0295
PlntWhlMaxFricScaleCffRear = 1.0295
PlntWhlMaxFzFrnt = 6570
PlntWhlMaxFzRear = 6570
PlntWhlMaxPressFrnt = 1000000
PlntWhlMaxPressRear = 1000000
PlntWhlMaxSlipAngleFrnt = 1.5
PlntWhlMaxSlipAngleRear = 1.5
PlntWhlMaxSlipRatioFrnt = 0.6
PlntWhlMaxSlipRatioRear = 0.6
PlntWhlMinCmbrFrnt = -0.17453
PlntWhlMinCmbrRear = -0.17453
PlntWhlMinFzFrnt = 100
PlntWhlMinFzRear = 100
PlntWhlMinPressFrnt = 10000
PlntWhlMinPressRear = 10000
PlntWhlMinSlipAngleFrnt = -1.5
PlntWhlMinSlipAngleRear = -1.5
PlntWhlMinSlipRatioFrnt = -0.6
PlntWhlMinSlipRatioRear = -0.6
PlntWhlNomNorlForceFrnt = 4000
PlntWhlNomNorlForceRear = 4000
PlntWhlNomPressFrnt = 220000
PlntWhlNomPressRear = 220000
PlntWhlNrmlForceExpFrnt = 1
PlntWhlNrmlForceExpRear = 1
PlntWhlNumFrnt = 2
PlntWhlNumRear = 2
PlntWhlPrsFrnt = 220000
PlntWhlPrsRear = 220000
PlntWhlQuadVelForceCompFrnt = 0
PlntWhlQuadVelForceCompRear = 0
PlntWhlRimRadiusFrnt = 0.2286
PlntWhlRimRadiusRear = 0.2286
PlntWhlRlxLngthFrnt = 0.15
PlntWhlRlxLngthLat = 0.15
PlntWhlRlxLngthLatFrnt = 0.1
PlntWhlRlxLngthLatRear = 0.1
PlntWhlRlxLngthRear = 0.15
PlntWhlRollResVelThreshFrnt = 0.1
PlntWhlRollResVelThreshRear = 0.1
PlntWhlStcFricCffFrnt = 1.3803
PlntWhlStcFricCffRear = 1.3803
PlntWhlTirPrsExpFrnt = 0
PlntWhlTirPrsExpRear = 0
PlntWhlUnldRadiusFrnt = 0.336
PlntWhlUnldRadiusRear = 0.336
PlntWhlVelIndpntForceCffFrnt = 0.01
PlntWhlVelIndpntForceCffRear = 0.01
PlntWhlVelThreshFrnt = 0.1
PlntWhlVelThreshRear = 0.1
PlntWhlVelTolLowVelFrnt = 1
PlntWhlVelTolLowVelRear = 1
PlntWhlVertDampCoeff = [50 50 50 50]
PlntWhlVertDampCoeffFrnt = 50
PlntWhlVertDampCoeffRear = 50
PlntWhlWidthFrnt = 0.235
PlntWhlWidthRear = 0.235