% Simulink data dictionary Scenario.sldd

Scn3DFrameRate = 0.03
ScnBrakePedalTime = 20
ScnBrkAx = 0.5
ScnBrkAxdec = 0.5
ScnBrkXbrake = 175
ScnCRLatAccStop = "off"
ScnCRMaxLatAccel = 0.5
ScnCRRadius = 100
ScnDLCGateLongPos = 175
ScnDLCLatRef = [2.1 3.3 4.5 5.7 6.9 8.1 9.3 10.5 11.54987 12.19912 12.2 12.20088 12.85013 13.9 17.34 20.78 24.22 27.66 31.1 33.15867 34.43177 34.6 35.36558 37.1746 38.1 40.81429 43.52857 46.24286 48.95714 51.67143 54.38571 57.1 57.81429 58.52857 59.24286 59.95714 60.67143 61.38571]
ScnDLCLatRefOffset = 5.7
ScnDLCLongRefBpt = [0 0.185 0.37 0.555 0.74 0.925 1.11 1.295 1.48 1.665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 59.9]
ScnDLCLongRefStartPos = 2
ScnDLCVehicleWidth = 2
ScnFHCounterDwellTime = 3
ScnFHInitialDwellTime = 0.5
ScnFHReturnTime = 2
ScnFHRollRateZeroCross = 1.5
ScnFHSteerAmp = 540
ScnFHSteerSpeed = 720
ScnFHUseRollRate = "off"
ScnISHandwheelRate = 13.5
ScnISLatAccStop = "on"
ScnISMaxHandwheelAng = 30
ScnISMaxLatAccel = 0.9
ScnISSteerHoldTime = 2
ScnLongVelRef = 50
ScnLongVelUnit = "mph"
ScnManType = 1
ScnOutVelUnit = "mph"
ScnRPGNumHrznPts = 20

ScnRPGRefPathXY = [0 0 0
 36.336 0 0
 72.672 0 0
 109.008 0 0
 145.344 0 0
 181.68 0 0
 218.016 0 0
 254.352 0 0
 290.688 0 0
 327.024 0 0
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 ]

ScnRPGWayPtSrchDist = 100
ScnSDDwellTime = 0.5
ScnSDSteerAmp = 90
ScnSDSteerFreq = 0.7
ScnSSFinalFreq = 0.7
ScnSSSteerAmp = 90
ScnSSSweepTime = 30
ScnStartTime = 2
ScnSteerDir = "Right"
ScnTimeToStrtDecel = 20
ScnWOTEndTime = 40
ScnWOTSrcVelUnit = "mph"
Sig = Simulink.Signal()