% Simulink data dictionary Trailer.sldd

PlntTraAeroDragCff = 0.15
PlntTraAeroFrntArea = 2.436
PlntTraAeroLiftCff = 0.1
PlntTraAeroPitchCff = 0.1
PlntTraAxlIxx = 2
PlntTraAxlM = 20
PlntTraAxleTrq = 0
PlntTraBrkActrBoreFrnt = 0.05
PlntTraBrkKinFricCffFrnt = 0.35
PlntTraBrkNumPadsFrnt = 2
PlntTraBrkPadMeanRadiusFrnt = 0.15
PlntTraBrkStcFricCffFrnt = 0.45
PlntTraCGHgtAxl = 0.3
PlntTraCzWhlAxl = 557960
PlntTraDstCGFrntAxl = 0.5
PlntTraDstCGMiddleAxl = 1.25
PlntTraDstCGRearAxl = 1.5
PlntTraF0zWhlAxl = 16132
PlntTraFriction = [1; 1]
PlntTraFrntUnsprgMass = 100
PlntTraFzFlt = 10
PlntTraGround = [0; 0]
PlntTraHtchCxy = 9047.8
PlntTraHtchCz = 2010.6
PlntTraHtchDstFrnt = 1.75
PlntTraHtchF0z = 872
PlntTraHtchHgtAxlFrnt = 0
PlntTraHtchKxy = 63165
PlntTraHtchKz = 14037
PlntTraInitLatVel = 0
PlntTraInitLongPos = -4
PlntTraInitLongVel = 0
PlntTraInitPitchAng = 0
PlntTraInitPitchRate = 0
PlntTraInitRollAng = 0
PlntTraInitRollRate = 0
PlntTraInitVertPos = 0
PlntTraInitVertVel = 0
PlntTraInitYawAng = 0
PlntTraInitYawRate = 0
PlntTraKzWhlAxl = 58429000
PlntTraMass = 408.23
PlntTraNumWhlFrntAxl = 2
PlntTraNumWhlMiddleAxl = 2
PlntTraNumWhlRearAxl = 2
PlntTraPitchMomentInertia = 327.45
PlntTraRearUnsprgMass = 100
PlntTraRollMomentInertia = 166.15
PlntTraRollResCffa = 196
PlntTraRollResCffb = 2.232
PlntTraSuspCz = 2938.1
PlntTraSuspF0z = 1274.2
PlntTraSuspHmax = 0.25
PlntTraSuspKz = 20512
PlntTraTrckWdth = 1.499
PlntTraVehFzFlt = 10
PlntTraWhlAng = repmat(0, 1, 6)
PlntTraWhlCambStiff = 10000
PlntTraWhlCompDamp = 50000
PlntTraWhlCompStiff = 500000
PlntTraWhlDampCoeff = [0.0010005 0.0010005]
PlntTraWhlDampCoeffFrnt = 0.001
PlntTraWhlDampCoeffRear = 0.001
PlntTraWhlHubCompDamp = 40000
PlntTraWhlHubCompStiff = 1000000
PlntTraWhlInertia = [1.084 1.084]
PlntTraWhlInertiaFrnt = 0.8
PlntTraWhlInertiaRear = 0.8
PlntTraWhlInitAngVel = 0
PlntTraWhlInitAngVelRear = 0
PlntTraWhlInitVel = 0
PlntTraWhlKinFricCff = 0.5
PlntTraWhlLatStiff = 45000
PlntTraWhlLdRadius = 0.327
PlntTraWhlLnrVelForceComp = 0
PlntTraWhlLongCuvFctr = 0.97
PlntTraWhlLongPeakFctr = 1
PlntTraWhlLongScaleFctr = 0.9
PlntTraWhlLongShapeFctr = 1.9
PlntTraWhlLongSpd = 16.7
PlntTraWhlLongStfFctr = 10
PlntTraWhlLongStiff = 500000
PlntTraWhlMass = 11.2
PlntTraWhlMassFrnt = 11.2
PlntTraWhlMassRear = 11.2
PlntTraWhlMaxCmbr = 0.17453
PlntTraWhlMaxFz = 8600
PlntTraWhlMaxPress = 1000000
PlntTraWhlMaxSlipAngle = 1.5
PlntTraWhlMaxSlipRatio = 1.5
PlntTraWhlMinCmbr = -0.17453
PlntTraWhlMinFz = 100
PlntTraWhlMinPress = 10000
PlntTraWhlMinSlipAngle = -1.5
PlntTraWhlMinSlipRatio = -1.5
PlntTraWhlNomNorlForce = 4300
PlntTraWhlNomPress = 262000
PlntTraWhlNrmlForceExp = 1
PlntTraWhlPrsFrnt = 220000
PlntTraWhlPrsRear = 220000
PlntTraWhlQuadVelForceComp = 0
PlntTraWhlRimRadius = 0.2286
PlntTraWhlRlxLngth = 0.15
PlntTraWhlRlxLngthFrnt = 0.1
PlntTraWhlRlxLngthLat = 0.15
PlntTraWhlRlxLngthLatFrnt = 0.1
PlntTraWhlRlxLngthLatRear = 0.1
PlntTraWhlRlxLngthRear = 0.1
PlntTraWhlRollResVelThresh = 0.1
PlntTraWhlStcFricCff = 0.8
PlntTraWhlTirPrsExp = 0
PlntTraWhlUnldRadius = 0.33454
PlntTraWhlVelIndpntForceCff = 0.01
PlntTraWhlVelThresh = 0.1
PlntTraWhlVelTolLowVel = 1
PlntTraWhlVertDampCoeff = 500
PlntTraWhlVertDampCoeffFrnt = 1000
PlntTraWhlVertDampCoeffRear = 1000
PlntTraWhlWidth = 0.235
PlntTraYawMomentInertia = 313.44